# Requirement set eyes_functional_requirements (R2024a)

## 1 [EyesFR_1] Kinematics (Container)

### 1.1 [EyesFR_2] Range of motion
The eye bulbs must guarantee the range of motion (tilt, pan) of the head Mk 2.
- Tilt: [-30 30] deg
- Pan: [-68 68] deg

### 1.2 [EyesFR_3] Velocity
The eye bulbs must guarantee to reach the maximum velocities (tilt, pan) of the head Mk 2.
- Tilt: FIXME
- Pan: FIXME