# Requirement set eyes_stakeholder_needs (R2023b)

## 1 [EyesSN_1] Robustness (Container)

### 1.1 [EyesSN_2] Wiring static robustness
Wiring must not break or unplug when eyes cover their entire RoM.

### 1.2 [EyesSN_3] Wiring dynamic robustness
This requirement refines EyesSN_2 in that we must guarantee that the wiring remains robust in all dynamic operating conditions of the eyes:
- Eye bulbs move covering all the possible characteristic velocities of the mechanism.

## 2 [EyesSN_4] Kinematics (Container)

### 2.1 [EyesSN_5] Range of motion
The eye bulbs must guarantee the range of motion (tilt, pan) of the head Mk 2.
- Tilt: [-30 30] deg
- Pan: [-68 68] deg

### 2.2 [EyesSN_6] Velocity
The eye bulbs must guarantee to reach the maximum velocities (tilt, pan) of the head Mk 2.

## 3 [EyesSN_7] Camera performance (Container)
As a reference, see https://icub-tech-iit.github.io/documentation/upgrade_kits/head_4k/support/.

### 3.1 [EyesSN_8] Camera resolution
The new cameras must guarantee 4k resolution.

### 3.2 [EyesSN_9] Camera field of view
The new cameras must guarantee 170 deg as the FoV.

### 3.3 [EyesSN_10] Camera frame rate
The new cameras must guarantee 30 fps.

## 4 [EyesSN_11] Onboard computational units (Container)

### 4.1 [EyesSN_12] GPU (Informational)
The head Mk 3 must mount NVidia Orin NX board to be used to acquire the video stream from cameras.

## 5 [EyesSN_13] Maintenance (Container)

### 5.1 [EyesSN_14] Ease of maintenance
The eyes shall expose ease access to perform maintenance / repairments.