% Simulink data dictionary neck_mk3.sldd

MCU_Ts = 0.001

Data_ControlCommands = Simulink.Bus()
  Voltage: single[3], Min=-100, Max=100, Unit="%"  % Actuation voltage signals.

Data_JointReferences = Simulink.Bus()
  SetPoints: single[3], Unit="deg"  % Setpoints that the system needs to track.

Physical_MotorRotationals = Simulink.ConnectionBus()
  Motor1: Connection: foundation.mechanical.rotational.rotational
  Motor2: Connection: foundation.mechanical.rotational.rotational
  Motor3: Connection: foundation.mechanical.rotational.rotational
  Reference: Connection: foundation.mechanical.rotational.rotational

Physical_MotorPhases = Simulink.ConnectionBus()
  Phase1_Pos: Connection: foundation.electrical.electrical
  Phase2_Pos: Connection: foundation.electrical.electrical
  Phase3_Pos: Connection: foundation.electrical.electrical
  Phase_Neg: Connection: foundation.electrical.electrical

Physical_Environment = Simulink.ConnectionBus()
  World: Connection: simmechanics.connections.frame

Selector_Controller = Simulink.Parameter(Types_Controller.Mk2, DataType="Enum: Types_Controller")
Selector_Mechanism = Simulink.Parameter(Types_Mechanism.Mk2, DataType="Enum: Types_Mechanism")
Selector_Motor = Simulink.Parameter(Types_Motor.DC_Faulhaber_2342S_012_CR, DataType="Enum: Types_Motor")
Selector_Transmission = Simulink.Parameter(Types_Transmission.Mk2, DataType="Enum: Types_Transmission")

Physical_TransmissionRotationals = Simulink.ConnectionBus()
  Transmission1_Stage1: Connection: foundation.mechanical.rotational.rotational
  Transmission1_Stage2: Connection: foundation.mechanical.rotational.rotational
  Transmission2_Stage1: Connection: foundation.mechanical.rotational.rotational
  Transmission2_Stage2: Connection: foundation.mechanical.rotational.rotational
  Transmission3_Stage1: Connection: foundation.mechanical.rotational.rotational
  Transmission3_Stage2: Connection: foundation.mechanical.rotational.rotational
  Reference: Connection: foundation.mechanical.rotational.rotational

Selector_MotorDriver = Simulink.Parameter(Types_MotorDriver.DC_Ideal_12V, DataType="Enum: Types_MotorDriver")
Selector_SignalProcessing = Simulink.Parameter(Types_SignalProcessing.None, DataType="Enum: Types_SignalProcessing")
Selector_Sensing = Simulink.Parameter(Types_Sensing.Ideal, DataType="Enum: Types_Sensing")
Selector_Planner = Simulink.Parameter(Types_Planner.MinJerk, DataType="Enum: Types_Planner")

Physical_MotorTranslationals = Simulink.ConnectionBus()
  Motor1: Connection: foundation.mechanical.translational.translational
  Motor2: Connection: foundation.mechanical.translational.translational
  Motor3: Connection: foundation.mechanical.translational.translational
  Reference: Connection: foundation.mechanical.translational.translational

Physical_TransmissionTranslationals = Simulink.ConnectionBus()
  Transmission1_Stage1: Connection: foundation.mechanical.translational.translational
  Transmission1_Stage2: Connection: foundation.mechanical.translational.translational
  Transmission2_Stage1: Connection: foundation.mechanical.translational.translational
  Transmission2_Stage2: Connection: foundation.mechanical.translational.translational
  Transmission3_Stage1: Connection: foundation.mechanical.translational.translational
  Transmission3_Stage2: Connection: foundation.mechanical.translational.translational
  Reference: Connection: foundation.mechanical.translational.translational

Req_Control_SettlingTime = Simulink.Parameter(2, Unit="s")  % Required settling time.
Variants = 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

Physical_Actuation = Simulink.ConnectionBus()
  Motor_Rotationals: Bus: Physical_MotorRotationals
  Motor_Translationals: Bus: Physical_MotorTranslationals
  Transmission_Rotationals: Bus: Physical_TransmissionRotationals
  Transmission_Translationals: Bus: Physical_TransmissionTranslationals

Physical_Multibody = Simulink.ConnectionBus()
  Payload_base_frame: Connection: simmechanics.connections.frame
  Joint1_B: Connection: simmechanics.connections.frame
  Joint1_F: Connection: simmechanics.connections.frame
  Joint2_B: Connection: simmechanics.connections.frame
  Joint2_F: Connection: simmechanics.connections.frame
  Joint3_B: Connection: simmechanics.connections.frame
  Joint3_F: Connection: simmechanics.connections.frame

Selector_Payload = Simulink.Parameter(Types_Payload.ergoCubHead, DataType="Enum: Types_Payload")

Data_ControlFeedback = Simulink.Bus()
  Encoders: single[3], Unit="deg"
  Velocities: single[3], Unit="deg/s"
  Currents: single[3], Unit="A"

Param_Planner_MinJerk_ReactionTime = Simulink.Parameter(0.5, Min=0, Unit="s")
Param_SigProcessing_SpeedMeas_Delays = Simulink.Parameter(4, Min=1, Unit="1")
Req_Velocity_Peak = Simulink.Parameter(200, Min=0, Unit="deg/s")  % Reachable maximum velocity during a minimum-jerk movement.

Req_DOF_Bounds = Simulink.Parameter([-45 22; -20 20; -45 45], Unit="deg")  % Minimum and maximum bounds of the DOFs.
  % The order is PRY.

Req_Velocity_Avg = Simulink.Parameter(100, Min=0, Unit="deg/s")  % Reachable average velocity during a minimum-jerk movement.

Data_Measurements = Simulink.Bus()
  Encoders: single[3], Unit="deg"
  Currents: single[3], Unit="A"
  Power: single[3], Unit="W"
  Torques: single[9], Unit="N*m"
  Velocities: single[9], Unit="deg/s"
  Payload_orientation: single[4], Unit="1"  % Quaternion