% Simulink data dictionary neck_mk2_data.sldd

mk2_front_pulley_diam = 31.7
mk2_side_pulley_diam = 30.5
mk2_small_pulley_diam = 11

mk2_smiData = struct(
  RigidTransform=[struct(
    translation=[0 0 0],
    angle=0,
    axis=[0 0 0],
    ID="B[RC_IIT_010_G_008_asm:1895:-:RC_IIT_010_G_008_asm:1891]"), struct(
    translation=[0 0 -0.15],
    angle=3.141593,
    axis=[0 -0.7071068 -0.7071068],
    ID="F[RC_IIT_010_G_008_asm:1895:-:RC_IIT_010_G_008_asm:1891]"), struct(
    translation=[0 0 0],
    angle=0,
    axis=[0 0 0],
    ID="B[RC_IIT_010_G_008_asm:1893:-:RC_IIT_010_G_008_asm:1894]"), struct(
    translation=[0 -0.15 2.775558e-17],
    angle=0,
    axis=[0 0 0],
    ID="F[RC_IIT_010_G_008_asm:1893:-:RC_IIT_010_G_008_asm:1894]"), struct(
    translation=[0 0 0],
    angle=0,
    axis=[0 0 0],
    ID="B[RC_IIT_010_G_008_asm:1894:-:RC_IIT_010_G_008_asm:1895]"), struct(
    translation=[0 -0.15 2.775558e-17],
    angle=0,
    axis=[0 0 0],
    ID="F[RC_IIT_010_G_008_asm:1894:-:RC_IIT_010_G_008_asm:1895]"), struct(
    translation=[0 0 0],
    angle=0,
    axis=[0 0 0],
    ID="B[RC_IIT_010_G_008_asm:1896:-:RC_IIT_010_G_008_asm:1901]"), struct(
    translation=[0 -0.15 2.775558e-17],
    angle=0,
    axis=[0 0 0],
    ID="F[RC_IIT_010_G_008_asm:1896:-:RC_IIT_010_G_008_asm:1901]"), struct(
    translation=[0 0.15 0],
    angle=2.094395,
    axis=[-0.5773503 -0.5773503 -0.5773503],
    ID="B[RC_IIT_010_G_008_asm:1897:-:RC_IIT_010_G_008_asm:1898]"), struct(
    translation=[0 3.552714e-15 -7.888609e-31],
    angle=2.094395,
    axis=[-0.5773503 -0.5773503 -0.5773503],
    ID="F[RC_IIT_010_G_008_asm:1897:-:RC_IIT_010_G_008_asm:1898]"), struct(
    translation=[0 0.15 0],
    angle=2.094395,
    axis=[-0.5773503 -0.5773503 -0.5773503],
    ID="B[RC_IIT_010_G_008_asm:1898:-:RC_IIT_010_G_008_asm:1899]"), struct(
    translation=[0 3.552714e-15 -7.888609e-31],
    angle=2.094395,
    axis=[-0.5773503 -0.5773503 -0.5773503],
    ID="F[RC_IIT_010_G_008_asm:1898:-:RC_IIT_010_G_008_asm:1899]"), struct(
    translation=[0 0.15 0],
    angle=2.094395,
    axis=[-0.5773503 -0.5773503 -0.5773503],
    ID="B[RC_IIT_010_G_008_asm:1899:-:RC_IIT_010_G_008_asm:1900]"), struct(
    translation=[0 7.105427e-15 -1.577722e-30],
    angle=2.094395,
    axis=[-0.5773503 -0.5773503 -0.5773503],
    ID="F[RC_IIT_010_G_008_asm:1899:-:RC_IIT_010_G_008_asm:1900]"), struct(
    translation=[0 0 0],
    angle=0,
    axis=[0 0 0],
    ID="B[RC_IIT_010_G_008_asm:1901:-:RC_IIT_010_G_008_asm:1902]"), struct(
    translation=[0 -0.15 1.423861e-14],
    angle=0,
    axis=[0 0 0],
    ID="F[RC_IIT_010_G_008_asm:1901:-:RC_IIT_010_G_008_asm:1902]"), struct(
    translation=[0 0 0],
    angle=0,
    axis=[0 0 0],
    ID="B[RC_IIT_010_G_008_asm:1902:-:RC_IIT_010_G_008_asm:1903]"), struct(
    translation=[0 -0.15 -1.41831e-14],
    angle=0,
    axis=[0 0 0],
    ID="F[RC_IIT_010_G_008_asm:1902:-:RC_IIT_010_G_008_asm:1903]"), struct(
    translation=[0 0 0],
    angle=0,
    axis=[0 0 0],
    ID="B[RC_IIT_010_G_008_asm:1903:-:RC_IIT_010_G_008_asm:1904]"), struct(
    translation=[0 -0.15 1.423861e-14],
    angle=0,
    axis=[0 0 0],
    ID="F[RC_IIT_010_G_008_asm:1903:-:RC_IIT_010_G_008_asm:1904]"), struct(
    translation=[0 0 0],
    angle=0,
    axis=[0 0 0],
    ID="B[RC_IIT_010_G_008_asm:1904:-:RC_IIT_010_G_008_asm:1905]"), struct(
    translation=[0 -0.15 2.775558e-17],
    angle=0,
    axis=[0 0 0],
    ID="F[RC_IIT_010_G_008_asm:1904:-:RC_IIT_010_G_008_asm:1905]"), struct(
    translation=[0 0 0],
    angle=0,
    axis=[0 0 0],
    ID="B[RC_IIT_010_G_008_asm:1905:-:RC_IIT_010_G_008_asm:1906]"), struct(
    translation=[0 -0.15 2.775558e-17],
    angle=0,
    axis=[0 0 0],
    ID="F[RC_IIT_010_G_008_asm:1905:-:RC_IIT_010_G_008_asm:1906]"), struct(
    translation=[0 0 0],
    angle=0,
    axis=[0 0 0],
    ID="B[RC_IIT_010_G_008_asm:34:-:RC_IIT_010_G_008_asm:1378]"), struct(
    translation=[3.552714e-15 0 -9.85],
    angle=2.094395,
    axis=[0.5773503 0.5773503 -0.5773503],
    ID="F[RC_IIT_010_G_008_asm:34:-:RC_IIT_010_G_008_asm:1378]"), struct(
    translation=[0 0 0],
    angle=0,
    axis=[0 0 0],
    ID="B[RC_IIT_010_G_008_asm:34:-:RC_IIT_010_G_008_asm:1891]"), struct(
    translation=[0 0 -0.2],
    angle=2.094395,
    axis=[0.5773503 0.5773503 -0.5773503],
    ID="F[RC_IIT_010_G_008_asm:34:-:RC_IIT_010_G_008_asm:1891]"), struct(
    translation=[0 0 0],
    angle=0,
    axis=[0 0 0],
    ID="B[RC_IIT_010_G_008_asm:34:-:RC_IIT_010_G_008_asm:1893]"), struct(
    translation=[0 0.25 -5.551115e-17],
    angle=3.141593,
    axis=[0.7071068 -0.7071068 0],
    ID="F[RC_IIT_010_G_008_asm:34:-:RC_IIT_010_G_008_asm:1893]"), struct(
    translation=[0 0 0],
    angle=0,
    axis=[0 0 0],
    ID="B[RC_IIT_010_G_008_asm:34:-:RC_IIT_010_G_008_asm:1894]"), struct(
    translation=[0 0.1 -1.387779e-17],
    angle=3.141593,
    axis=[0.7071068 -0.7071068 0],
    ID="F[RC_IIT_010_G_008_asm:34:-:RC_IIT_010_G_008_asm:1894]"), struct(
    translation=[0 0 0],
    angle=0,
    axis=[0 0 0],
    ID="B[RC_IIT_010_G_008_asm:34:-:RC_IIT_010_G_008_asm:1895]"), struct(
    translation=[0 -0.05 6.938894e-18],
    angle=3.141593,
    axis=[0.7071068 -0.7071068 0],
    ID="F[RC_IIT_010_G_008_asm:34:-:RC_IIT_010_G_008_asm:1895]"), struct(
    translation=[3.084333 -1.72498e-15 0],
    angle=2.094395,
    axis=[-0.5773503 -0.5773503 0.5773503],
    ID="B[RC_IIT_010_G_008_asm:34:-:RC_IIT_010_G_008_asm:1897]"), struct(
    translation=[-1.776357e-15 -12.28433 1.776357e-15],
    angle=2.094395,
    axis=[-0.5773503 -0.5773503 -0.5773503],
    ID="F[RC_IIT_010_G_008_asm:34:-:RC_IIT_010_G_008_asm:1897]"), struct(
    translation=[3.084333 -1.72498e-15 0],
    angle=2.094395,
    axis=[-0.5773503 -0.5773503 0.5773503],
    ID="B[RC_IIT_010_G_008_asm:34:-:RC_IIT_010_G_008_asm:1898]"), struct(
    translation=[-1.776357e-15 -12.43433 1.776357e-15],
    angle=2.094395,
    axis=[-0.5773503 -0.5773503 -0.5773503],
    ID="F[RC_IIT_010_G_008_asm:34:-:RC_IIT_010_G_008_asm:1898]"), struct(
    translation=[3.084333 -1.72498e-15 0],
    angle=2.094395,
    axis=[-0.5773503 -0.5773503 0.5773503],
    ID="B[RC_IIT_010_G_008_asm:34:-:RC_IIT_010_G_008_asm:1899]"), struct(
    translation=[-1.776357e-15 -12.58433 3.552714e-15],
    angle=2.094395,
    axis=[-0.5773503 -0.5773503 -0.5773503],
    ID="F[RC_IIT_010_G_008_asm:34:-:RC_IIT_010_G_008_asm:1899]")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],
  Solid=[struct(
    mass=0.0005513495,
    CoM=[0 1.25 0],
    MoI=[0.001527698 0.002481073 0.001527698],
    PoI=[0 0 0],
    color=[0.76 0.08 0.08],
    opacity=1,
    ID="MAGNET6MM_prt"), struct(
    mass=0.01702078,
    CoM=[-0.2616 -1.08404 0.008719744],
    MoI=[2.04336 1.834313 1.723959],
    PoI=[-0.004597856 0.0004341545 0.01516324],
    color=[0.53 0.53 0.53],
    opacity=1,
    ID="RC_IIT_010_P_008_prt"), struct(
    mass=0.001278008,
    CoM=[0 0 0],
    MoI=[0.02692465 0.02692467 0.05244317],
    PoI=[0 0 0],
    color=[0.4128 0.4128 0.4128],
    opacity=1,
    ID="RMB_UL_1015X_prt"), struct(
    mass=0.007458683,
    CoM=[0 0 2.5],
    MoI=[0.3896094 0.3896092 0.753432],
    PoI=[0 0 0],
    color=[0.4128 0.4128 0.4128],
    opacity=1,
    ID="61802_prt"), struct(
    mass=0.01129208,
    CoM=[0 0.3477026 -0.9792167],
    MoI=[0.8161332 1.344257 0.9520677],
    PoI=[-0.0112796 0 0],
    color=[0.576 0.711 0.657],
    opacity=1,
    ID="RC_IIT_010_P_071_prt"), struct(
    mass=0.001914758,
    CoM=[0 13.09741 8.31248],
    MoI=[0.007278074 0.0352016 0.03212976],
    PoI=[-8.595779e-05 0 0],
    color=[0.432 0.432 0.432],
    opacity=1,
    ID="RC_IIT_010_P_072_prt"), struct(
    mass=0.0001580953,
    CoM=[0 0 1.717438],
    MoI=[0.0002966509 0.0002966509 0.0002116792],
    PoI=[0 0 0],
    color=[0.5 0.5 0.5],
    opacity=1,
    ID="V2-3--_-_ISO7045_CZ_prt"), struct(
    mass=0.004467658,
    CoM=[6.753466 0 0],
    MoI=[0.3012443 0.2896632 0.2941252],
    PoI=[0 0 0],
    color=[0.4517647 0.4517647 0.4517647],
    opacity=1,
    ID="HFUC-8-100-2A-R_C_prt"), struct(
    mass=0.02703333,
    CoM=[-0.08576013 56.59644 -18.26369],
    MoI=[9.277635 5.739512 13.92702],
    PoI=[1.653479 -0.009632551 -0.00257456],
    color=[0.702 0.648 0.405],
    opacity=1,
    ID="RC_IIT_010_P_024_prt"), struct(
    mass=0.002757124,
    CoM=[-1.432354 0 0],
    MoI=[0.03491454 0.05948679 0.05948678],
    PoI=[0 0 0],
    color=[0.576 0.711 0.657],
    opacity=1,
    ID="RC_IIT_010_P_025_prt"), struct(
    mass=1.493874e-05,
    CoM=[0 0.075 0],
    MoI=[4.924415e-05 9.843228e-05 4.924415e-05],
    PoI=[0 0 0],
    color=[0.225 0.6003 0.6003],
    opacity=1,
    ID="MYONIC_SHIM_PS_4_6_THK_0-15_prt"), struct(
    mass=0.001886124,
    CoM=[0 0 2],
    MoI=[0.01822189 0.01822189 0.03244841],
    PoI=[0 0 0],
    color=[0.4128 0.4128 0.4128],
    opacity=1,
    ID="619-4_prt"), struct(
    mass=8.343442e-05,
    CoM=[0 0 1.25],
    MoI=[0.0003005376 0.0003005378 0.0005141646],
    PoI=[0 0 0],
    color=[0.69 0.69 0.69],
    opacity=1,
    ID="RC_IIT_010_P_030_prt"), struct(
    mass=0.0007381137,
    CoM=[0 0 1.25],
    MoI=[0.004874203 0.004874204 0.00911317],
    PoI=[0 0 0],
    color=[0.4128 0.4128 0.4128],
    opacity=1,
    ID="618-4_prt"), struct(
    mass=0.001617508,
    CoM=[-0.8327782 9.84827 0],
    MoI=[0.1046747 0.01369273 0.09160059],
    PoI=[0 0 0.004156903],
    color=[0.702 0.648 0.405],
    opacity=1,
    ID="RC_IIT_010_P_026_prt"), struct(
    mass=0.0003214671,
    CoM=[0 0 2.23442],
    MoI=[0.00101259 0.001012591 0.0006766766],
    PoI=[0 0 0],
    color=[0.5 0.5 0.5],
    opacity=1,
    ID="V2_5-4--_-_ISO7045_CZ_prt"), struct(
    mass=3.917054e-05,
    CoM=[0 0.2910954 0.2],
    MoI=[0.000160007 9.649073e-05 0.0002554532],
    PoI=[0 0 0],
    color=[0.2997 0.2997 0.2997],
    opacity=1,
    ID="A4--_-_U7435_prt"), struct(
    mass=8.457595e-05,
    CoM=[0 0 3],
    MoI=[0.0002607361 0.0002607362 2.35725e-05],
    PoI=[0 0 0],
    color=[0.4852943 0.464706 0.4411762],
    opacity=1,
    ID="S1_5-6--_-_I2338_B_prt"), struct(
    mass=0.0001226814,
    CoM=[0 0 0.25],
    MoI=[0.0004567838 0.0004567837 0.0009084557],
    PoI=[0 0 0],
    color=[0.4128 0.4128 0.4128],
    opacity=1,
    ID="R3--_-_U6592_prt"), struct(
    mass=0.0006773271,
    CoM=[0 0 -0.5789978],
    MoI=[0.003074555 0.003074557 0.00221082],
    PoI=[0 0 0],
    color=[0.70272 0.7592 0.8],
    opacity=1,
    ID="V3-4--_-_U5931_GC_prt"), struct(
    mass=0.001011251,
    CoM=[0 0 2.133359],
    MoI=[0.02080336 0.02080336 0.002491282],
    PoI=[0 0 0],
    color=[0.70272 0.7592 0.8],
    opacity=1,
    ID="V3-12--_-_U5931_GC_prt"), struct(
    mass=0.02982581,
    CoM=[27.98219 26.17535 -8.308159],
    MoI=[18.45387 6.264491 13.26851],
    PoI=[-1.494764 0.1052944 -1.121137],
    color=[0.53 0.53 0.53],
    opacity=1,
    ID="RC_IIT_010_P_013_prt"), struct(
    mass=0.01191153,
    CoM=[14.74635 0 0],
    MoI=[1.956883 0.9861832 1.010202],
    PoI=[-0.01200987 0 0],
    color=[0.6776471 0.6776471 0.6776471],
    opacity=1,
    ID="HFUC-8-100-2A-R_A_prt"), struct(
    mass=0.01540802,
    CoM=[0 0 0],
    MoI=[3.598688 1.8246 1.824601],
    PoI=[0 0 0],
    color=[0.6003 0.9 0.9],
    opacity=1,
    ID="KAA10XL0_prt"), struct(
    mass=0.1030439,
    CoM=[-3.329529 0.01205774 0],
    MoI=[6.467557 24.95729 24.97614],
    PoI=[0 -0.0001271347 0.02713344],
    color=[0.15 0.15 0.16],
    opacity=1,
    ID="2342S012CR_IE2_512_LC_prt"), struct(
    mass=0.001465033,
    CoM=[-0.09341027 1.534643 0.0004078219],
    MoI=[0.01982034 0.02105584 0.01930231],
    PoI=[1.334991e-06 -3.243568e-06 -0.0003058104],
    color=[0.36 0.333 0.306],
    opacity=1,
    ID="RC_IIT_010_P_014_prt"), struct(
    mass=0.0001763936,
    CoM=[0.3178733 0 0],
    MoI=[0.007634534 0.003822157 0.003822158],
    PoI=[0 0 0],
    color=[0.5 0.5 0.5],
    opacity=1,
    ID="B75_prt"), struct(
    mass=0.0003678989,
    CoM=[0 -0.0774625 0.5],
    MoI=[0.005887485 0.004331714 0.01015788],
    PoI=[0 0 0],
    color=[0.2997 0.2997 0.2997],
    opacity=1,
    ID="A9--_-_U7435_prt"), struct(
    mass=0.0001490563,
    CoM=[0 0 2.11862],
    MoI=[0.0005660769 0.000566077 0.0001347991],
    PoI=[0 0 0],
    color=[0.4128 0.4128 0.4128],
    opacity=1,
    ID="V2-6--_-_ISO7046-1_CH_prt"), struct(
    mass=0.0002347502,
    CoM=[0 0 3],
    MoI=[0.000781269 0.0007812692 0.0001815661],
    PoI=[0 0 0],
    color=[0.4852943 0.464706 0.4411762],
    opacity=1,
    ID="S2_5-6--_-_I2338_B_prt"), struct(
    mass=0.0001503171,
    CoM=[0 0 3],
    MoI=[0.0004796175 0.0004796176 7.445015e-05],
    PoI=[0 0 0],
    color=[0.4852943 0.464706 0.4411762],
    opacity=1,
    ID="S2-6--_-_I2338_B_prt"), struct(
    mass=8.103228e-05,
    CoM=[0 0 -1.750886],
    MoI=[0.0001232878 0.0001232878 4.878289e-05],
    PoI=[0 0 0],
    color=[0.4128 0.4128 0.4128],
    opacity=1,
    ID="G2-5-4--_-_U5923_G_prt"), struct(
    mass=0.02531935,
    CoM=[-27.67221 25.73389 -5.099231],
    MoI=[15.82916 4.085721 12.76123],
    PoI=[-1.988089 0.1109649 1.036818],
    color=[0.53 0.53 0.53],
    opacity=1,
    ID="RC_IIT_010_P_015_prt"), struct(
    mass=5.442916e-05,
    CoM=[0 0 -1.32944],
    MoI=[5.837388e-05 5.837388e-05 3.480794e-05],
    PoI=[0 0 0],
    color=[0.4128 0.4128 0.4128],
    opacity=1,
    ID="G2-5-3--_-_U5923_G_prt"), struct(
    mass=0.0004363799,
    CoM=[0 0 3.039073],
    MoI=[0.003085958 0.003085959 0.0008454903],
    PoI=[0 0 0],
    color=[0.4128 0.4128 0.4128],
    opacity=1,
    ID="V3-8--_-_ISO7046-1_CH_prt"), struct(
    mass=0.01179477,
    CoM=[15.34586 -0.002140098 0.002243917],
    MoI=[0.3899513 0.2718532 0.2718551],
    PoI=[0 0.0001484174 -0.0001479631],
    color=[0.5 0.5 0.5],
    opacity=1,
    ID="HFUC-8-100-2A-R_B_prt"), struct(
    mass=0.001170433,
    CoM=[0.009688884 1.126825 -0.02140343],
    MoI=[0.04027325 0.001410138 0.04029012],
    PoI=[2.059565e-05 -2.432193e-07 -0.0001011588],
    color=[0.576 0.711 0.657],
    opacity=1,
    ID="RC_IIT_010_P_016_prt"), struct(
    mass=0.0003562634,
    CoM=[0 0 1],
    MoI=[0.001410108 0.001410108 0.002626438],
    PoI=[0 0 0],
    color=[0.4128 0.4128 0.4128],
    opacity=1,
    ID="618-3_prt"), struct(
    mass=0.002923803,
    CoM=[1.707302 0 0],
    MoI=[0.5055862 0.3564164 0.1527676],
    PoI=[-0.1489953 0 0],
    color=[0.4128 0.4128 0.4128],
    opacity=1,
    ID="RC_IIT_010_P_017_prt"), struct(
    mass=0.002158619,
    CoM=[-0.1660108 -0.1887742 -0.000198591],
    MoI=[0.05076084 0.09131565 0.04864718],
    PoI=[0 3.728388e-06 -0.0001832035],
    color=[0.36 0.333 0.306],
    opacity=1,
    ID="RC_IIT_010_P_027_prt")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],
  CylindricalJoint=[struct(Rz=struct(Pos=90), Pz=struct(Pos=0), ID="[7040:228:34:-:7040:228:1897]"), struct(Rz=struct(Pos=90), Pz=struct(Pos=0), ID="[7040:228:34:-:7040:228:1898]"), struct(Rz=struct(Pos=90), Pz=struct(Pos=0), ID="[7040:228:34:-:7040:228:1899]"), struct(Rz=struct(Pos=90), Pz=struct(Pos=0), ID="[7040:228:34:-:7040:228:1900]"), struct(Rz=struct(Pos=-6.361109e-15), Pz=struct(Pos=0), ID="[7040:228:34:-:7040:228:61]"), struct(Rz=struct(Pos=90), Pz=struct(Pos=0), ID="[7040:53:-:7040:326]"), struct(Rz=struct(Pos=150), Pz=struct(Pos=0), ID="[36880:49:-:36880:32]"), struct(Rz=struct(Pos=2.000813), Pz=struct(Pos=0), ID="[7040:219:-:7066]"), struct(Rz=struct(Pos=180), Pz=struct(Pos=0), ID="[7066:-:36864]"), struct(Rz=struct(Pos=-2.000813), Pz=struct(Pos=0), ID="[7040:224:-:7068]"), struct(Rz=struct(Pos=-125.3625), Pz=struct(Pos=0), ID="[7040:224:-:20225]"), struct(Rz=struct(Pos=-60), Pz=struct(Pos=0), ID="[36880:35:-:36875]")],
  PlanarJoint=[struct(Rz=struct(Pos=1.272222e-14), Px=struct(Pos=0), Py=struct(Pos=0), ID="[7040:228:1897:-:7040:228:1898]"), struct(Rz=struct(Pos=1.272222e-14), Px=struct(Pos=0), Py=struct(Pos=0), ID="[7040:228:1898:-:7040:228:1899]"), struct(Rz=struct(Pos=1.272222e-14), Px=struct(Pos=0), Py=struct(Pos=0), ID="[7040:228:1899:-:7040:228:1900]"), struct(Rz=struct(Pos=90), Px=struct(Pos=0), Py=struct(Pos=0), ID="[7040:228:61:-:7040:228:1897]"), struct(Rz=struct(Pos=180), Px=struct(Pos=0), Py=struct(Pos=0), ID="[7040:228:112:-:7040:228:61]"), struct(Rz=struct(Pos=90), Px=struct(Pos=0), Py=struct(Pos=0), ID="[7040:-:7040:326]"), struct(Rz=struct(Pos=180), Px=struct(Pos=0), Py=struct(Pos=0), ID="[36880:32:-:36880:35]"), struct(Rz=struct(Pos=-30), Px=struct(Pos=0), Py=struct(Pos=0), ID="[36880:41:-:36880:32]"), struct(Rz=struct(Pos=2.000813), Px=struct(Pos=0), Py=struct(Pos=0), ID="[7040:2341:-:7066]"), struct(Rz=struct(Pos=153.29), Px=struct(Pos=0), Py=struct(Pos=0), ID="[7066:-:10879]"), struct(Rz=struct(Pos=-2.000813), Px=struct(Pos=0), Py=struct(Pos=0), ID="[7040:2340:-:7068]"), struct(Rz=struct(Pos=26.71), Px=struct(Pos=0), Py=struct(Pos=0), ID="[10879:-:36864]")],
  PrismaticJoint=struct(Pz=struct(Pos=0), ID="[19638:-:10879]"),
  RectangularJoint=struct(Px=struct(Pos=0), Py=struct(Pos=0), ID="[7068:-:20225]"),
  RevoluteJoint=[struct(Rz=struct(Pos=-180), ID="[7040:228:112:-:7040:228:34]"), struct(Rz=struct(Pos=-180), ID="[7040:228:112:-:7040:228:41]"), struct(Rz=struct(Pos=-89.99919), ID="[7040:106:-:7040:53]"), struct(Rz=struct(Pos=-2.000813), ID="[7040:90:-:7040:2341]"), struct(Rz=struct(Pos=-177.9992), ID="[7040:94:-:7040:2340]"), struct(Rz=struct(Pos=-30), ID="[36880:44:-:36880:35]")])