% Simulink data dictionary neck_mk3_serial_data.sldd

mk3_serial_smiData = struct(
  RigidTransform=[struct(translation=[0 0 0], angle=1.570796, axis=[1 0 0], ID="UCS[IC_033_G_032_asm:79]"), struct(translation=[0 0 0], angle=0, axis=[0 0 0], ID="B[IC_033_G_004_asm:61:-:IC_033_G_004_asm:64]"), struct(
    translation=[1.5 -2.220446e-16 0],
    angle=1.570796,
    axis=[-0 -0 -1],
    ID="F[IC_033_G_004_asm:61:-:IC_033_G_004_asm:64]"), struct(translation=[0 0 0], angle=0, axis=[0 0 0], ID="B[IC_033_G_004_asm:61:-:IC_033_G_004_asm:69]"), struct(translation=[0 -9 0], angle=3.141593, axis=[1 0 0], ID="F[IC_033_G_004_asm:61:-:IC_033_G_004_asm:69]"), struct(translation=[0 0 0], angle=0, axis=[0 0 0], ID="B[IC_033_G_004_asm:61:-:IC_033_G_004_asm:74]"), struct(
    translation=[-3.38125 -4.440892e-16 0],
    angle=3.141593,
    axis=[0.7071068 0.7071068 0],
    ID="F[IC_033_G_004_asm:61:-:IC_033_G_004_asm:74]"), struct(
    translation=[0 -0.445 0],
    angle=2.094395,
    axis=[-0.5773503 -0.5773503 -0.5773503],
    ID="B[IC_033_G_004_asm:61:-:IC_033_G_004_asm:77]"), struct(
    translation=[-9.20421e-14 1.284306e-12 4.945],
    angle=3.141593,
    axis=[-1 8.301698e-29 -4.570062e-14],
    ID="F[IC_033_G_004_asm:61:-:IC_033_G_004_asm:77]"), struct(translation=[0 0 0], angle=0, axis=[0 0 0], ID="B[IC_033_G_004_asm:61:-:IC_033_G_004_asm:82]"), struct(
    translation=[0 8.881784e-16 -7.2625],
    angle=1.570796,
    axis=[1 0 0],
    ID="F[IC_033_G_004_asm:61:-:IC_033_G_004_asm:82]"), struct(translation=[0 0 0], angle=0, axis=[0 0 0], ID="B[IC_033_G_004_asm:61:-:IC_033_G_004_asm:532]"), struct(
    translation=[4.6 -10.25 31.5],
    angle=2.094395,
    axis=[-0.5773503 -0.5773503 -0.5773503],
    ID="F[IC_033_G_004_asm:61:-:IC_033_G_004_asm:532]"), struct(translation=[0 0 0], angle=0, axis=[0 0 0], ID="B[IC_033_G_004_asm:61:-:IC_033_G_004_asm:536]"), struct(
    translation=[4.6 -4.45 31.5],
    angle=2.094395,
    axis=[-0.5773503 -0.5773503 -0.5773503],
    ID="F[IC_033_G_004_asm:61:-:IC_033_G_004_asm:536]"), struct(translation=[0 0 0], angle=0, axis=[0 0 0], ID="B[IC_033_G_004_asm:64:-:IC_033_G_004_asm:85]"), struct(
    translation=[-1.972152e-31 4.440892e-16 -3.2],
    angle=2.094395,
    axis=[-0.5773503 -0.5773503 -0.5773503],
    ID="F[IC_033_G_004_asm:64:-:IC_033_G_004_asm:85]"), struct(translation=[0 0 0], angle=0, axis=[0 0 0], ID="B[IC_033_G_004_asm:74:-:IC_033_G_004_asm:82]"), struct(
    translation=[0 8.881784e-16 -3.88125],
    angle=2.094395,
    axis=[-0.5773503 -0.5773503 -0.5773503],
    ID="F[IC_033_G_004_asm:74:-:IC_033_G_004_asm:82]"), struct(translation=[0 0 0], angle=0, axis=[0 0 0], ID="B[IC_033_G_004_asm:85:-:IC_033_G_004_asm:580]"), struct(
    translation=[-0.5 0 3.138931e-16],
    angle=2.094395,
    axis=[0.5773503 0.5773503 0.5773503],
    ID="F[IC_033_G_004_asm:85:-:IC_033_G_004_asm:580]"), struct(translation=[0 0 0], angle=0, axis=[0 0 0], ID="B[IC_033_G_030_asm:60:-:IC_033_G_030_asm:61]"), struct(translation=[-41.61875 0 0], angle=0, axis=[0 0 0], ID="F[IC_033_G_030_asm:60:-:IC_033_G_030_asm:61]"), struct(translation=[0 0 0], angle=0, axis=[0 0 0], ID="B[IC_033_G_030_asm:60:-:IC_033_G_030_asm:62]"), struct(
    translation=[7.105427e-15 0 37.7375],
    angle=1.570796,
    axis=[0 1 0],
    ID="F[IC_033_G_030_asm:60:-:IC_033_G_030_asm:62]"), struct(translation=[0 0 0], angle=0, axis=[0 0 0], ID="B[IC_033_G_030_asm:60:-:IC_033_G_030_asm:65]"), struct(
    translation=[7.105427e-15 53 0],
    angle=1.570796,
    axis=[-0 -0 -1],
    ID="F[IC_033_G_030_asm:60:-:IC_033_G_030_asm:65]"), struct(
    translation=[35.655 0 0],
    angle=2.094395,
    axis=[0.5773503 0.5773503 0.5773503],
    ID="B[IC_033_G_030_asm:60:-:IC_033_G_030_asm:68]"), struct(
    translation=[9.769963e-14 1.464143e-13 -4.845],
    angle=1.884111e-15,
    axis=[0.809017 0.5877853 4.47974e-16],
    ID="F[IC_033_G_030_asm:60:-:IC_033_G_030_asm:68]"), struct(translation=[0 0 0], angle=0, axis=[0 0 0], ID="B[IC_033_G_030_asm:60:-:IC_033_G_030_asm:69]"), struct(
    translation=[46.5 0 0],
    angle=3.141593,
    axis=[0 1 0],
    ID="F[IC_033_G_030_asm:60:-:IC_033_G_030_asm:69]"), struct(translation=[0 0 0], angle=0, axis=[0 0 0], ID="B[IC_033_G_030_asm:61:-:IC_033_G_030_asm:62]"), struct(
    translation=[4.440892e-16 0 -3.88125],
    angle=1.570796,
    axis=[0 1 0],
    ID="F[IC_033_G_030_asm:61:-:IC_033_G_030_asm:62]"), struct(translation=[0 0 0], angle=0, axis=[0 0 0], ID="B[IC_033_G_030_asm:69:-:IC_033_G_030_asm:386]"), struct(
    translation=[-4.440892e-16 0 3.2],
    angle=1.570796,
    axis=[-0 1 -0],
    ID="F[IC_033_G_030_asm:69:-:IC_033_G_030_asm:386]"), struct(translation=[0 0 0], angle=0, axis=[0 0 0], ID="B[IC_033_G_030_asm:386:-:IC_033_G_030_asm:508]"), struct(
    translation=[-0.5 0 0],
    angle=3.141593,
    axis=[-0.7071068 0 0.7071068],
    ID="F[IC_033_G_030_asm:386:-:IC_033_G_030_asm:508]"), struct(translation=[0 0 0], angle=0, axis=[0 0 0], ID="B[IC_033_G_029_asm:1383:68:-:IC_033_G_029_asm:1756]"), struct(
    translation=[2.180551e-13 19.25 -5.5],
    angle=2.827433,
    axis=[-5.932783e-16 -1.650637e-17 -1],
    ID="F[IC_033_G_029_asm:1383:68:-:IC_033_G_029_asm:1756]"), struct(translation=[0 0 0], angle=0, axis=[0 0 0], ID="B[IC_033_G_029_asm:1383:68:-:IC_033_G_029_asm:1758]")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],
  Solid=[struct(
    mass=0.03046098,
    CoM=[-8.313346 -0.3385613 -44.73648],
    MoI=[7.152277 4.635348 11.43332],
    PoI=[0.0006457788 0.01504164 0.1379804],
    color=[0.5 0.5 0.5],
    opacity=1,
    ID="IC_033_P_033_prt"), struct(
    mass=0.04474751,
    CoM=[-2.152308 -9.122388 -8.871],
    MoI=[15.31696 19.82141 6.703006],
    PoI=[-0.5197185 -1.088497 -0.2930997],
    color=[0.5 0.5 0.5],
    opacity=1,
    ID="IC_033_P_034_prt"), struct(
    mass=0.0001503171,
    CoM=[0 0 3],
    MoI=[0.0004796175 0.0004796176 7.445015e-05],
    PoI=[0 0 0],
    color=[0.5 0.5 0.5],
    opacity=1,
    ID="S2-6--_-_I2338_B_prt"), struct(
    mass=0.000352887,
    CoM=[0 0 7],
    MoI=[0.005801703 0.005801703 0.0001757351],
    PoI=[0 0 0],
    color=[0.5 0.5 0.5],
    opacity=1,
    ID="S2-14--_-_I2338_B_prt"), struct(
    mass=0.0014924,
    CoM=[0 0 -7.120992],
    MoI=[0.07279941 0.07279943 0.002737894],
    PoI=[0 0 0],
    color=[0.5 0.5 0.5],
    opacity=1,
    ID="M3X20-6LOBE-ISO14580-A2-70_prt"), struct(
    mass=0.01191153,
    CoM=[14.74635 0 0],
    MoI=[1.956883 0.9861832 1.010202],
    PoI=[-0.01200987 0 0],
    color=[0.5 0.5 0.5],
    opacity=1,
    ID="HFUC-8-100-2A-R_A_prt"), struct(
    mass=0.006684238,
    CoM=[-0.07633886 -0.07633984 -9.835759],
    MoI=[0.6259032 0.6259031 0.624352],
    PoI=[0.00405818 0.004058178 3.93441e-05],
    color=[0.5 0.5 0.5],
    opacity=1,
    ID="IC_033_P_027_prt"), struct(
    mass=0.013,
    CoM=[0 0 1.5],
    MoI=[0.1195682 0.1195683 0.2244276],
    PoI=[0 0 0],
    color=[0.5 0.5 0.5],
    opacity=1,
    ID="627-6-2Z_prt"), struct(
    mass=0.000447057,
    CoM=[0 0 -0.01675059],
    MoI=[0.01112519 0.01112519 0.02217733],
    PoI=[0 0 0],
    color=[0.5 0.5 0.5],
    opacity=1,
    ID="IC_033_P_025_prt"), struct(
    mass=6.071981e-05,
    CoM=[0 0 0.9957581],
    MoI=[6.392706e-05 6.392707e-05 4.296482e-05],
    PoI=[0 0 0],
    color=[0.5 0.5 0.5],
    opacity=1,
    ID="V1_6-3--_-_ISO7046-1_CH_prt"), struct(
    mass=0.002382617,
    CoM=[11.30589 -0.01862462 -0.01862458],
    MoI=[0.01359016 0.06817079 0.0681708],
    PoI=[2.143543e-06 -0.0003741227 -0.0003741233],
    color=[0.5 0.5 0.5],
    opacity=1,
    ID="IC_033_P_010_prt"), struct(
    mass=0.0667,
    CoM=[0.0135092 -1.387744 -8.141787],
    MoI=[7.229371 5.715011 9.604044],
    PoI=[0.0895147 0.00446244 0.02023181],
    color=[0.5 0.5 0.5],
    opacity=1,
    ID="FAULHABER_3216W024BXTH_prt"), struct(
    mass=0.0001390974,
    CoM=[0 0 -1.333437],
    MoI=[0.0003257372 0.0003257372 0.0001253227],
    PoI=[0 0 0],
    color=[0.5 0.5 0.5],
    opacity=1,
    ID="MISUMI_CBSTSE2-4_prt"), struct(
    mass=0.0001226814,
    CoM=[0 0 0.25],
    MoI=[0.0004567838 0.0004567837 0.0009084557],
    PoI=[0 0 0],
    color=[0.5 0.5 0.5],
    opacity=1,
    ID="R3--_-_U6592_prt"), struct(
    mass=0.01179477,
    CoM=[15.34586 -0.002140098 0.002243917],
    MoI=[0.3899513 0.2718532 0.2718551],
    PoI=[0 0.0001484174 -0.0001479631],
    color=[0.5 0.5 0.5],
    opacity=1,
    ID="HFUC-8-100-2A-R_B_prt"), struct(
    mass=2.890521e-05,
    CoM=[0 0 -0.1953472],
    MoI=[4.349444e-05 4.349443e-05 5.118271e-05],
    PoI=[0 0 0],
    color=[0.5 0.5 0.5],
    opacity=1,
    ID="IC_033_P_028_prt"), struct(
    mass=0.0004245589,
    CoM=[0 0 -3.954959],
    MoI=[0.007675089 0.00767509 0.000402792],
    PoI=[0 0 0],
    color=[0.5 0.5 0.5],
    opacity=1,
    ID="M2X12-6LOBE-ISO14583-A2-70_prt"), struct(
    mass=0.020186,
    CoM=[-3.957923 -2.852962 2.163556],
    MoI=[1.569019 3.553924 2.585746],
    PoI=[0.07629935 0.4533915 -0.1395788],
    color=[0.5 0.5 0.5],
    opacity=1,
    ID="IC_033_P_001_prt"), struct(
    mass=0.0005513495,
    CoM=[0 1.25 0],
    MoI=[0.001527698 0.002481073 0.001527698],
    PoI=[0 0 0],
    color=[0.5 0.5 0.5],
    opacity=1,
    ID="MAGNET6MM_prt"), struct(
    mass=0.005558003,
    CoM=[-0.03731386 0.1166569 3.902705],
    MoI=[1.057685 1.068718 2.106492],
    PoI=[-0.0003872733 0.0001238728 0.007060555],
    color=[0.5 0.5 0.5],
    opacity=1,
    ID="IC_033_P_002_prt"), struct(
    mass=0.01185233,
    CoM=[0 0 0],
    MoI=[2.768222 1.403539 1.403539],
    PoI=[0 0 0],
    color=[0.5 0.5 0.5],
    opacity=1,
    ID="KAA10CL0_prt"), struct(
    mass=0.004760683,
    CoM=[0 0 0],
    MoI=[0.4096629 0.4096629 0.8121848],
    PoI=[0 0 0],
    color=[0.5 0.5 0.5],
    opacity=1,
    ID="IC_033_P_012_prt"), struct(
    mass=7.033275e-05,
    CoM=[0 0 2.5],
    MoI=[0.000153062 0.000153062 1.95666e-05],
    PoI=[0 0 0],
    color=[0.5 0.5 0.5],
    opacity=1,
    ID="S1_5-5--_-_I2338_B_prt"), struct(
    mass=0.004467658,
    CoM=[6.753466 0 0],
    MoI=[0.3012443 0.2896632 0.2941252],
    PoI=[0 0 0],
    color=[0.5 0.5 0.5],
    opacity=1,
    ID="HFUC-8-100-2A-R_C_prt"), struct(
    mass=0.0007787451,
    CoM=[0 0 0],
    MoI=[0.007973536 0.00797354 0.01581729],
    PoI=[0 0 0],
    color=[0.5 0.5 0.5],
    opacity=1,
    ID="4_3X12X1-ISO7093-A2_prt"), struct(
    mass=0.001618918,
    CoM=[0.1818924 0 0],
    MoI=[0.008190889 0.01574807 0.01574807],
    PoI=[0 0 0],
    color=[0.5 0.5 0.5],
    opacity=1,
    ID="M4X06-F-ISO4762-12_9-BLACK_prt"), struct(
    mass=0.0003701443,
    CoM=[0 0 2.749501],
    MoI=[0.006935755 0.006935752 0.0003882227],
    PoI=[0 0 0],
    color=[0.5 0.5 0.5],
    opacity=1,
    ID="V2-12--_-_U5931_GC_AUTOB_prt"), struct(
    mass=0.0003828164,
    CoM=[0 0 -6.327414],
    MoI=[0.007160615 0.007160615 0.0002624621],
    PoI=[0 0 0],
    color=[0.5 0.5 0.5],
    opacity=1,
    ID="M2X14-6LOBE-ISO14581-A2-70_prt"), struct(
    mass=0.04442467,
    CoM=[0 -0.2983311 8.401502],
    MoI=[7.055834 13.69903 18.71331],
    PoI=[-0.01016166 0 0],
    color=[0.5 0.5 0.5],
    opacity=1,
    ID="IC_033_P_004_prt"), struct(
    mass=0.01684278,
    CoM=[0 0 0],
    MoI=[7.838861 3.947038 3.94704],
    PoI=[0 0 0],
    color=[0.5 0.5 0.5],
    opacity=1,
    ID="KAA15CL0_prt"), struct(
    mass=0.008993436,
    CoM=[-0.05673551 -0.05673604 -20.01315],
    MoI=[3.110806 3.110805 0.6409063],
    PoI=[0.009251106 0.009251063 2.921145e-05],
    color=[0.5 0.5 0.5],
    opacity=1,
    ID="IC_033_P_023_prt"), struct(
    mass=0.009021431,
    CoM=[24.68089 -0.00491874 -0.004918844],
    MoI=[0.04346604 1.398377 1.398377],
    PoI=[1.656976e-06 -0.0009676379 -0.0009676215],
    color=[0.5 0.5 0.5],
    opacity=1,
    ID="IC_033_P_022_prt"), struct(
    mass=0.002583267,
    CoM=[0 0 -0.006835542],
    MoI=[0.4257218 0.4257214 0.8504856],
    PoI=[0 0 0],
    color=[0.5 0.5 0.5],
    opacity=1,
    ID="IC_033_P_029_prt"), struct(
    mass=0.0174,
    CoM=[0 8.926644 16.85537],
    MoI=[7.171972 4.842362 10.38346],
    PoI=[0.3993333 0 0],
    color=[0.5 0.5 0.5],
    opacity=1,
    ID="IC_033_P_038_prt"), struct(
    mass=0.01481055,
    CoM=[46.27323 0 6.152498],
    MoI=[2.577814 1.866692 1.08115],
    PoI=[0 -0.1589106 0],
    color=[0.5 0.5 0.5],
    opacity=1,
    ID="IC_033_P_037_prt"), struct(
    mass=0.002932209,
    CoM=[-2.206211 0.01044969 8.540252],
    MoI=[1.327267 0.2492347 1.225732],
    PoI=[-0.0003252797 0.0296038 4.460354e-05],
    color=[0.5 0.5 0.5],
    opacity=1,
    ID="IC_033_P_035_prt"), struct(
    mass=2.598072e-05,
    CoM=[-1.5 0 0],
    MoI=[2.356765e-05 2.873403e-05 2.873406e-05],
    PoI=[0 0 0],
    color=[0.5 0.5 0.5],
    opacity=1,
    ID="MINI-TECH_MTEC-B-M1_6_prt"), struct(
    mass=0.0002282397,
    CoM=[-0.01696102 0.06399371 0.3129428],
    MoI=[0.0009173402 0.003242374 0.003988929],
    PoI=[2.950633e-05 2.488192e-06 1.55769e-05],
    color=[0.5 0.5 0.5],
    opacity=1,
    ID="AEA3_SSI_MPCA_prt"), struct(
    mass=0.0001188738,
    CoM=[0 0 -0.2237201],
    MoI=[0.0002157807 0.0002157808 0.0001063834],
    PoI=[0 0 0],
    color=[0.5 0.5 0.5],
    opacity=1,
    ID="M1_6X03-6LOBE-ISO14583-A4-70_prt"), struct(
    mass=0.000840469,
    CoM=[0 0 -9.186709],
    MoI=[0.03152609 0.03152609 0.0008673543],
    PoI=[0 0 0],
    color=[0.5 0.5 0.5],
    opacity=1,
    ID="M2_5X20-6LOBE-ISO14581-A2-70_prt")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],
  CylindricalJoint=[struct(Rz=struct(Pos=-162), Pz=struct(Pos=0), ID="[33033:61:-:33033:1383:68]"), struct(Rz=struct(Pos=90), Pz=struct(Pos=0), ID="[45555:-:7848:77]")],
  PrismaticJoint=struct(Pz=struct(Pos=0), ID="[33033:2550:-:33033:1383:60]"),
  RevoluteJoint=[struct(Rz=struct(Pos=-90), ID="[7848:61:-:7848:77]"), struct(Rz=struct(Pos=-162), ID="[33033:1383:60:-:33033:1383:68]"), struct(Rz=struct(Pos=180), ID="[33033:61:-:33033:2550]"), struct(Rz=struct(Pos=-157.5), ID="[33033:67:-:33033:1383:69]"), struct(Rz=struct(Pos=180), ID="[40739:2033:-:40739:1286]"), struct(Rz=struct(Pos=180), ID="[40739:91:-:40739:94]"), struct(Rz=struct(Pos=90), ID="[45555:-:7848:74]")])