% Simulink data dictionary ergocub_head_data.sldd

ergoCubHead_mass_scale = Simulink.Parameter(1, Unit="1")  % Scaling factor to increase/reduce head weight.

ergoCubHeadData = struct(
  RigidTransform=[struct(
    translation=[-0.03 -67.37151 444.8125],
    angle=1.570796,
    axis=[0.000129791 0.000129790995347 -1],
    ID="UCS[ERGOCUB_HEAD_prt:7981]"), struct(
    translation=[1.915e-12 -4.861512 368.42],
    angle=1.570796,
    axis=[-5.5e-15 1e-15 -1],
    ID="UCS[ERGOCUB_HEAD_prt:7982]"), struct(
    translation=[7.68e-13 -4.911512 503.2225],
    angle=3.0e-15,
    axis=[0 -1 0],
    ID="UCS[ERGOCUB_HEAD_prt:7983]"), struct(
    translation=[-5.5 -0.5615123 406.6545],
    angle=3.141593,
    axis=[-1 -5.0e-16 -1.5e-15],
    ID="UCS[ERGOCUB_HEAD_prt:7984]"), struct(translation=[91.36147 87.09939 -515.9285], angle=0, axis=[0 0 0], ID="SixDofRigidTransform[59]")],
  Solid=struct(
    mass=1.760079238,
    CoM=[-1.82833 8.732852 405.0718],
    MoI=[9200.561 7312.158 7658.108],
    PoI=[394.3724 -24.98996 -128.0669],
    color=[0.5 0.5 0.5],
    opacity=1,
    ID="ERGOCUB_HEAD_prt"))

ergoCubHead_z_offset = Simulink.Parameter(10, Unit="mm")  % Mounting height offset.