test file "test_req"

suite "Test Neck Mk2 ergoCub" (disabled)

  case "Test Range of Motion (ROM)" [simulation] (disabled)
    model arch_logical, harness arch_logical_Harness_ReqTest_FR_7, variant configuration Variant_NeckMk2_ergoCub
    post-load callback:
      sltest.harness.open(sltest_sut, sltest_bdroot);
    cleanup callback:
      run_mech_explorer("Variant_NeckMk2_ergoCub", "hidden");

  case "Test Home Configuration Alignment" [simulation] (disabled)
    model arch_logical, harness arch_logical_Harness_ReqTest_FR_19, variant configuration Variant_NeckMk2_ergoCub
    post-load callback:
      sltest.harness.open(sltest_sut, sltest_bdroot);
    cleanup callback:
      run_mech_explorer("Variant_NeckMk2_ergoCub", "hidden");

  case "Test High Performance" [simulation] (disabled)
    model arch_logical, harness arch_logical_Harness_ReqTest_HighPerformance, variant configuration Variant_NeckMk2_ergoCub
    parameter set "Parameter Set 1":
      Req_Control_SettlingTime = 2  % neck_mk3.sldd
      Req_Caps_Motor_Currents = [1.4; 1.4; 1.4]  % neck_mk3.sldd
      Req_Caps_Motor_Torques = [16; 16; 16]  % neck_mk3.sldd
      Req_Caps_Motor_Velocity = [7000; 7000; 7000]  % neck_mk3.sldd
      Req_Caps_Transmission_Torques = [2.4; 2.4; 2.4]  % neck_mk3.sldd
      Req_Caps_Transmission_Velocity = [85; 85; 85]  % neck_mk3.sldd
    post-load callback:
      sltest.harness.open(sltest_sut, sltest_bdroot);
    cleanup callback:
      run_mech_explorer("Variant_NeckMk2_ergoCub", "hidden");

suite "Test Neck Mk3 Serial ergoCub"

  case "Test Range of Motion (ROM)" [simulation]
    model arch_logical, harness arch_logical_Harness_ReqTest_FR_7, variant configuration Variant_NeckMk3_Serial_ergoCub
    post-load callback:
      sltest.harness.open(sltest_sut, sltest_bdroot);
    cleanup callback:
      run_mech_explorer("Variant_NeckMk3_Serial_ergoCub", "hidden");

  case "Test Home Configuration Alignment" [simulation]
    model arch_logical, harness arch_logical_Harness_ReqTest_FR_19, variant configuration Variant_NeckMk3_Serial_ergoCub
    post-load callback:
      sltest.harness.open(sltest_sut, sltest_bdroot);
    cleanup callback:
      run_mech_explorer("Variant_NeckMk3_Serial_ergoCub", "hidden");

  case "Test High Performance" [simulation]
    model arch_logical, harness arch_logical_Harness_ReqTest_HighPerformance, variant configuration Variant_NeckMk3_Serial_ergoCub
    parameter set "Parameter Set 1":
      Req_Control_SettlingTime = 2  % neck_mk3.sldd
      Req_Caps_Motor_Currents = [1.1; 1.1; 0.36]  % neck_mk3.sldd
      Req_Caps_Motor_Torques = [38; 38; 9.7]  % neck_mk3.sldd
      Req_Caps_Motor_Velocity = [4320; 4320; 2710]  % neck_mk3.sldd
      Req_Caps_Transmission_Torques = [2.4; 2.4; 2.4]  % neck_mk3.sldd
      Req_Caps_Transmission_Velocity = [85; 85; 85]  % neck_mk3.sldd
    post-load callback:
      sltest.harness.open(sltest_sut, sltest_bdroot);
    cleanup callback:
      run_mech_explorer("Variant_NeckMk3_Serial_ergoCub", "hidden");

  case "Test Varying Payload Mounting Offset" [simulation]
    model arch_logical, harness arch_logical_Harness_ReqTest_HighPerformance, variant configuration Variant_NeckMk3_Serial_ergoCub
    parameter set "Parameter Set 1":
      Req_Control_SettlingTime = 2  % neck_mk3.sldd
      Req_Caps_Motor_Currents = [1.1; 1.1; 0.36]  % neck_mk3.sldd
      Req_Caps_Motor_Torques = [38; 38; 9.7]  % neck_mk3.sldd
      Req_Caps_Motor_Velocity = [4320; 4320; 2710]  % neck_mk3.sldd
      Req_Caps_Transmission_Torques = [2.4; 2.4; 2.4]  % neck_mk3.sldd
      Req_Caps_Transmission_Velocity = [85; 85; 85]  % neck_mk3.sldd
    post-load callback:
      sltest.harness.open(sltest_sut, sltest_bdroot);
    iteration script:
      z_offsets = [0,10,15,20];  % [mm]

      for i = 1:length(z_offsets)
          testItr = sltestiteration;
          setVariable(testItr, 'Name', 'ergoCubHead_z_offset', 'Source', 'ergocub_head_data.sldd', 'Value', z_offsets(i));
          addIteration(sltest_testCase, testItr, ['Iteration #' num2str(i) ': ergoCubHead_z_offset = ' num2str(z_offsets(i)) ' mm']);
      end

  case "Test Varying Payload Weight" [simulation]
    model arch_logical, harness arch_logical_Harness_ReqTest_HighPerformance, variant configuration Variant_NeckMk3_Serial_ergoCub
    parameter set "Parameter Set 1":
      Req_Control_SettlingTime = 2  % neck_mk3.sldd
      Req_Caps_Motor_Currents = [1.1; 1.1; 0.36]  % neck_mk3.sldd
      Req_Caps_Motor_Torques = [38; 38; 9.7]  % neck_mk3.sldd
      Req_Caps_Motor_Velocity = [4320; 4320; 2710]  % neck_mk3.sldd
      Req_Caps_Transmission_Torques = [2.4; 2.4; 2.4]  % neck_mk3.sldd
      Req_Caps_Transmission_Velocity = [85; 85; 85]  % neck_mk3.sldd
    post-load callback:
      sltest.harness.open(sltest_sut, sltest_bdroot);
    iteration script:
      scales = [1, 1.05, 1.1, 1.2];  % [1]

      for i = 1:length(scales)
          testItr = sltestiteration;
          setVariable(testItr, 'Name', 'ergoCubHead_mass_scale', 'Source', 'ergocub_head_data.sldd', 'Value', scales(i));
          addIteration(sltest_testCase, testItr, ['Iteration #' num2str(i) ': ergoCubHead_mass_scale = ' num2str(scales(i))]);
      end

  case "Test Payload with Eyes" [simulation]
    model arch_logical, harness arch_logical_Harness_ReqTest_HighPerformance, variant configuration Variant_NeckMk3_Serial_ergoCubWithEyes
    parameter set "Parameter Set 1":
      Req_Control_SettlingTime = 2  % neck_mk3.sldd
      Req_Caps_Motor_Currents = [1.1; 1.1; 0.36]  % neck_mk3.sldd
      Req_Caps_Motor_Torques = [38; 38; 9.7]  % neck_mk3.sldd
      Req_Caps_Motor_Velocity = [4320; 4320; 2710]  % neck_mk3.sldd
      Req_Caps_Transmission_Torques = [2.4; 2.4; 2.4]  % neck_mk3.sldd
      Req_Caps_Transmission_Velocity = [85; 85; 85]  % neck_mk3.sldd
    post-load callback:
      sltest.harness.open(sltest_sut, sltest_bdroot);
    cleanup callback:
      run_mech_explorer("Variant_NeckMk3_Serial_ergoCubWithEyes", "hidden");

  case "Test External Disturbances" [simulation]
    model arch_logical, harness arch_logical_Harness_ReqTest_ExternalDisturbances, variant configuration Variant_NeckMk3_Serial_ergoCub_Disturbances
    parameter set "Parameter Set 1":
      Req_Caps_Motor_Currents = [1.65; 1.65; 0.54]  % neck_mk3.sldd
      Req_Caps_Motor_Torques = [100; 100; 14]  % neck_mk3.sldd
      Req_Caps_Motor_Velocity = [4320; 4320; 2710]  % neck_mk3.sldd
      Req_Caps_Transmission_Torques = [9; 9; 9]  % neck_mk3.sldd
      Req_Caps_Transmission_Velocity = [85; 85; 85]  % neck_mk3.sldd
      Param_ExternalDisturbances_AccelerationPeriod = [0.06; 0.06; 0.06]  % neck_mk3.sldd
      Param_Planner_MinJerk_ReactionTime = [0.8;0.4;1]  % neck_mk3.sldd
      Param_ExternalDisturbances_MaxAcceleration = [2; 2; 3]  % neck_mk3.sldd
    post-load callback:
      sltest.harness.open(sltest_sut, sltest_bdroot);
    cleanup callback:
      run_mech_explorer("Variant_NeckMk3_Serial_ergoCub_Disturbances", "hidden");

suite "Test Neck Mk2 iCub" (disabled)

  case "Test Range of Motion (ROM)" [simulation] (disabled)
    model arch_logical, harness arch_logical_Harness_ReqTest_FR_7, variant configuration Variant_NeckMk2_iCub
    post-load callback:
      sltest.harness.open(sltest_sut, sltest_bdroot);
    cleanup callback:
      run_mech_explorer("Variant_NeckMk2_iCub", "hidden");

  case "Test Home Configuration Alignment" [simulation] (disabled)
    model arch_logical, harness arch_logical_Harness_ReqTest_FR_19, variant configuration Variant_NeckMk2_iCub
    post-load callback:
      sltest.harness.open(sltest_sut, sltest_bdroot);
    cleanup callback:
      run_mech_explorer("Variant_NeckMk2_iCub", "hidden");

  case "Test High Performance" [simulation] (disabled)
    model arch_logical, harness arch_logical_Harness_ReqTest_HighPerformance, variant configuration Variant_NeckMk2_iCub
    parameter set "Parameter Set 1":
      Req_Control_SettlingTime = 2  % neck_mk3.sldd
      Req_Caps_Motor_Currents = [1.4; 1.4; 1.4]  % neck_mk3.sldd
      Req_Caps_Motor_Torques = [16; 16; 16]  % neck_mk3.sldd
      Req_Caps_Motor_Velocity = [7000; 7000; 7000]  % neck_mk3.sldd
      Req_Caps_Transmission_Torques = [2.4; 2.4; 2.4]  % neck_mk3.sldd
      Req_Caps_Transmission_Velocity = [85; 85; 85]  % neck_mk3.sldd
    post-load callback:
      sltest.harness.open(sltest_sut, sltest_bdroot);
    cleanup callback:
      run_mech_explorer("Variant_NeckMk2_iCub", "hidden");

suite "Test Neck Mk3 Serial iCub"

  case "Test Range of Motion (ROM)" [simulation]
    model arch_logical, harness arch_logical_Harness_ReqTest_FR_7, variant configuration Variant_NeckMk3_Serial_iCub
    post-load callback:
      sltest.harness.open(sltest_sut, sltest_bdroot);
    cleanup callback:
      run_mech_explorer("Variant_NeckMk3_Serial_iCub", "hidden");

  case "Test Home Configuration Alignment" [simulation]
    model arch_logical, harness arch_logical_Harness_ReqTest_FR_19, variant configuration Variant_NeckMk3_Serial_iCub
    post-load callback:
      sltest.harness.open(sltest_sut, sltest_bdroot);
    cleanup callback:
      run_mech_explorer("Variant_NeckMk3_Serial_iCub", "hidden");

  case "Test High Performance" [simulation]
    model arch_logical, harness arch_logical_Harness_ReqTest_HighPerformance, variant configuration Variant_NeckMk3_Serial_iCub
    parameter set "Parameter Set 1":
      Req_Control_SettlingTime = 2  % neck_mk3.sldd
      Req_Caps_Motor_Currents = [1.1; 1.1; 0.36]  % neck_mk3.sldd
      Req_Caps_Motor_Torques = [38; 38; 9.7]  % neck_mk3.sldd
      Req_Caps_Motor_Velocity = [4320; 4320; 2710]  % neck_mk3.sldd
      Req_Caps_Transmission_Torques = [2.4; 2.4; 2.4]  % neck_mk3.sldd
      Req_Caps_Transmission_Velocity = [85; 85; 85]  % neck_mk3.sldd
    post-load callback:
      sltest.harness.open(sltest_sut, sltest_bdroot);
    cleanup callback:
      run_mech_explorer("Variant_NeckMk3_Serial_iCub", "hidden");