% Requirement links of test_req.mldatx (R2024a)

item 1 verifies neck_functional_requirements.slreqx#19: NeckFR_19 Home Configuration aligned with Gravity
item 2 verifies neck_functional_requirements.slreqx#9: NeckFR_9 Reachable velocity
item 2 verifies neck_functional_requirements.slreqx#17: NeckFR_17 Current Caps
item 2 verifies neck_functional_requirements.slreqx#18: NeckFR_18 Torque Caps
item 2 verifies neck_functional_requirements.slreqx#20: NeckFR_14 Velocity Caps
item 3 verifies neck_functional_requirements.slreqx#9
item 3 verifies neck_functional_requirements.slreqx#17
item 3 verifies neck_functional_requirements.slreqx#18
item 3 verifies neck_functional_requirements.slreqx#20
item 4 verifies neck_functional_requirements.slreqx#19: NeckFR_19 Home Configuration aligned with Gravity
item 5 verifies neck_functional_requirements.slreqx#7: NeckFR_7 Range of motion
item 5 verifies neck_functional_requirements.slreqx#11: NeckFR_11 Current iCub head payload
item 5 verifies neck_functional_requirements.slreqx#12: NeckFR_12 Current ergoCub head payload
item 6 verifies neck_functional_requirements.slreqx#26
item 7 verifies neck_functional_requirements.slreqx#9: NeckFR_9 Reachable velocity
item 7 verifies neck_functional_requirements.slreqx#17: NeckFR_17 Current Caps
item 7 verifies neck_functional_requirements.slreqx#18: NeckFR_18 Torque Caps
item 7 verifies neck_functional_requirements.slreqx#20: NeckFR_14 Velocity Caps
item 8 verifies neck_functional_requirements.slreqx#7: NeckFR_7 Range of motion
item 8 verifies neck_functional_requirements.slreqx#11: NeckFR_11 Current iCub head payload
item 8 verifies neck_functional_requirements.slreqx#12: NeckFR_12 Current ergoCub head payload
item 9 verifies neck_functional_requirements.slreqx#19: NeckFR_19 Home Configuration aligned with Gravity
item 10 verifies neck_functional_requirements.slreqx#7
item 10 verifies neck_functional_requirements.slreqx#11
item 10 verifies neck_functional_requirements.slreqx#12
item 11 verifies neck_functional_requirements.slreqx#9: NeckFR_9 Reachable velocity
item 11 verifies neck_functional_requirements.slreqx#17: NeckFR_17 Current Caps
item 11 verifies neck_functional_requirements.slreqx#18: NeckFR_18 Torque Caps
item 11 verifies neck_functional_requirements.slreqx#20: NeckFR_14 Velocity Caps
item 12 verifies neck_functional_requirements.slreqx#7: NeckFR_7 Range of motion
item 12 verifies neck_functional_requirements.slreqx#11: NeckFR_11 Current iCub head payload
item 12 verifies neck_functional_requirements.slreqx#12: NeckFR_12 Current ergoCub head payload
item 13 verifies neck_functional_requirements.slreqx#19
item 14 verifies neck_functional_requirements.slreqx#9: NeckFR_9 Reachable velocity
item 14 verifies neck_functional_requirements.slreqx#17: NeckFR_17 Current Caps
item 14 verifies neck_functional_requirements.slreqx#18: NeckFR_18 Torque Caps
item 14 verifies neck_functional_requirements.slreqx#20: NeckFR_14 Velocity Caps
item 14 verifies neck_functional_requirements.slreqx#13
item 15 verifies neck_functional_requirements.slreqx#9: NeckFR_9 Reachable velocity
item 15 verifies neck_functional_requirements.slreqx#17: NeckFR_17 Current Caps
item 15 verifies neck_functional_requirements.slreqx#18: NeckFR_18 Torque Caps
item 15 verifies neck_functional_requirements.slreqx#20: NeckFR_14 Velocity Caps
item 16 verifies neck_functional_requirements.slreqx#9: NeckFR_9 Reachable velocity
item 16 verifies neck_functional_requirements.slreqx#17: NeckFR_17 Current Caps
item 16 verifies neck_functional_requirements.slreqx#18: NeckFR_18 Torque Caps
item 16 verifies neck_functional_requirements.slreqx#20: NeckFR_14 Velocity Caps
item 16 verifies neck_functional_requirements.slreqx#13